# Grasshopper definition 09062022_3beamtest3_KU.gh (Grasshopper 1.0.7)

# ---- group: Project Setup
modelinfo = CSharpScript(name="\"3beamtest\"", projectNumber="\"00\"")  # -> ModelInfo; inputs name: String, projectNumber: String
# ---------- modelinfo: C# ----------
    List<string> projectInfo = new List<string>();
    projectInfo.Add(name);
    projectInfo.Add(projectNumber);

    ModelInfo = projectInfo;
# ---------- end modelinfo ----------

# ---- group: Define Project Parameters
toggle = BooleanToggle(True)
list = ValueList({"Eurocode"}, selected="Eurocode")
list_2 = ValueList({"steel", "wood", "rcc": "RCC"}, selected="wood")
line = Line(Line((0, 0, 0), (1500, 0, 0)))
loadinfo = CSharpScript(gravitational=toggle, liveLoad=toggle)  # -> loadInfo; inputs gravitational: Boolean, liveLoad: Boolean
# ---------- loadinfo: C# ----------
    List<string> load = new List<string>();
    if (gravitational == true)
    {
      load.Add("gravitational");
    }
    if (liveLoad == true)
    {
      load.Add("liveLoad");
    }
    loadInfo = load;
# ---------- end loadinfo ----------
supportinfo = CSharpScript(number=Slider(3, range=0..10))  # -> supportInfo; inputs number: Int32
# ---------- supportinfo: C# ----------
    supportInfo = number;
# ---------- end supportinfo ----------
materialproperties = CSharpScript(type=list_2, code=list)  # -> materialInfo; inputs type: String, code: String
# ---------- materialproperties: C# ----------
    List<string> material = new List<string>();
    material.Add(type);
    material.Add(code);
    materialInfo = material;
# ---------- end materialproperties ----------
beamgeo = CSharpScript(line=line)  # -> beamGeo; inputs line: Line
# ---------- beamgeo: C# ----------
    List<Point3d> linePoints = new List<Point3d>();
    Point3d lineStart = line.PointAt(1);
    Point3d lineEnd = line.PointAt(0);
    linePoints.Add(lineStart);
    linePoints.Add(lineEnd);
    beamGeo = linePoints;
# ---------- end beamgeo ----------

# ----
panel = Panel(line)

# ---- group: Assembly
model = CSharpScript(Specs=modelinfo, nodes=supportinfo, elements=beamgeo, loads=loadinfo, material=materialproperties)  # -> out, oNodes, oElements, oLoads, oMaterial; inputs Specs: list of String, nodes: list of Int32, elements: list of Point3d, loads: list of String, material: list of String
# ---------- model: C# ----------
    oNodes = nodes;
    oElements = elements;
    oLoads = loads;
    oMaterial = material;
# ---------- end model ----------

# ----
python = GhPythonScript(x=line)  # -> out, a; inputs x: Line
# ---------- python: Python ----------
__author__ = "ukeer"
__version__ = "2022.06.16"

import rhinoscriptsyntax as rs

print(x.Length)
# ---------- end python ----------
panel_2 = Panel(model.oMaterial)
pt = Point([Point(1500, 0, 0), Point(0, 0, 0)])
iclcoretest = CSharpScript(
    environmentGeo=model.oElements,
    columnNumbers=model.oNodes,
    iLoads=model.oLoads,
    iMaterial=model.oMaterial,
    Reference=["C:\Users\ukeer\GitHub\ICL\ICL.Core\bin\ICL.Core.dll", "C:\Users\ukeer\AppData\Roaming\McNeel\Rhinoceros\packages\7.0\Karamba3D\2.2.0.12\KarambaCommon.dll", "C:\Users\ukeer\AppData\Roaming\McNeel\Rhinoceros\packages\7.0\Karamba3D\2.2.0.12\karamba.gha", "C:\Users\ukeer\AppData\Roaming\McNeel\Rhinoceros\packages\7.0\Karamba3D\2.2.0.12\karamba.dll", "C:\Users\ukeer\AppData\Roaming\Grasshopper\Libraries\ICD.AbmFramework.Core.dll"])  # -> out, A, B, C, D, E, F, G; inputs environmentGeo: list of Point3d, columnNumbers: Int32, iLoads: list of String, iMaterial: list of String
# ---------- iclcoretest: C# usings ----------
using ICL;
using ICL.Core;
using ICL.Core.AgentPos;
using ICL.Core.Environment;
using ICL.Core.AgentBehaviors;
using Karamba.Geometry;
using Karamba.Materials;
using Karamba.Supports;
using KarambaCommon;
using Karamba.CrossSections;
using Karamba.Elements;
using Karamba.Loads;
using Karamba.Models;
using ICD.AbmFramework.Core;
using System.Linq;
using ICD.AbmFramework.Core.Behavior;
using ICD.AbmFramework.Core.AgentSystem;
using ICD.AbmFramework.Core.Agent;
using ICD.AbmFramework.Core.Environments;
using ICL.Core.Solver;
# ---------- iclcoretest: C# ----------
    //Initialize agents
    BeamInitializeAgents agentStart = new BeamInitializeAgents(columnNumbers, environmentGeo);
    List<Point3d> agentStartPos = agentStart.ComputeColumnStartPos();

    //Initialize environment start
    BeamEnvironmentNodalDisplacement environmentStart = new BeamEnvironmentNodalDisplacement(agentStartPos, environmentGeo, iLoads, iMaterial);
    environmentStart.Execute();
    Dictionary<int, List<Point3d>> nodalDisplacement = environmentStart.NodalDisplacement;

    //Define Behavior
    MaxDisplacementBehavior maxDispBehavior = new MaxDisplacementBehavior();
    maxDispBehavior.NodalDisplacemenets = nodalDisplacement;

    //Define Cartesian Agents
    List<BehaviorBase> agentBehaviors = new List<BehaviorBase>();
    agentBehaviors.Add(maxDispBehavior);
    List<CartesianAgent> cartesianAgents = new List<CartesianAgent> ();
    foreach(Point3d pt in agentStartPos)
    {
      CartesianAgent agent = new CartesianAgent(pt, agentBehaviors);
      cartesianAgents.Add(agent);
    }

    //Define Cartesian Environment
    CartesianEnvironment environment = new CartesianEnvironment(environmentGeo);

    //Define Cartesian Agent System
    CartesianAgentSystem csSystem = new CartesianAgentSystem(cartesianAgents, environment);

//    //test
//    maxDispBehavior.Execute(cartesianAgents[1]);
    
    //solver
    BeamSolver testBeamSolver = new BeamSolver();
    



    A = agentStartPos;
    B = nodalDisplacement;
    C = maxDispBehavior;
    D = cartesianAgents;
    E = environment;
    F = csSystem;
    G = testBeamSolver;
    //    G = CartesianAgentSystem;


    //    int ind;
    //    Dictionary<string, List<Point3d>> testNeighbours = testBehavior.FindNeightbors(agentStartPos[0], out ind);
    //    for(int i = 0; i < testNeighbours.Count; i++)
    //    {
    //      var item = testNeighbours.ElementAt(i);
    //      Point3d node = item.Value[0];
    //      Point3d node2 = item.Value[1];
    //    }
    //    D = testNeighbours;
    //
    //    List<Point3d> newAgentPos = new List<Point3d>();
    //    Point3d p1 = new Point3d(44, 0, 0);
    //    Point3d p2 = new Point3d(700, 0, 0);
    //    Point3d p3 = new Point3d(900, 0, 0);
    //    newAgentPos.Add(p1);
    //    newAgentPos.Add(p2);
    //    newAgentPos.Add(p3);
    //
    //    environmentStart.AgentPositions = newAgentPos;
    //    environmentStart.UpdateEnvironment();
    //





    //call behaviour

    //create cartesian agent

    //call solver

    //out vizualize
# ---------- end iclcoretest ----------
panel_3 = Panel(iclcoretest.G)
crv = Curve(<curve referenced from the Rhino model>)  # disabled
test2 = CSharpScript(crv=crv)  # -> out, A; inputs crv: Curve; disabled
# ---------- test2: C# ----------
    double[] test = crv.DivideByCount(4, true);

    A = test;
# ---------- end test2 ----------
test1 = CSharpScript()  # -> out, A; disabled
# ---------- test1: C# usings ----------
using System.Collections.Generic;
using System.Linq;
using System.Text;
using System.Threading.Tasks;
using System;
# ---------- test1: C# ----------
    List<int> a = new List<int>();
    a.Add(1);
    a.Add(4);
    
    Dictionary<string, Point3d> dict = new Dictionary<string, Point3d>();
    
    dict.Add("1", new Point3d(0, 0, 0));
    
    foreach(var item in dict)
    {
      RhinoApp.WriteLine("key" + item.Key + "value" + item.Value);
      
    }
    dict["1"] = new Point3d(10, 0, 0);
//    dict.Clear();
    
    //    a.Clear();
    A = dict;
# ---------- end test1 ----------
c_script = CSharpScript(Reference="C:\Users\ukeer\AppData\Roaming\McNeel\Rhinoceros\packages\7.0\Karamba3D\2.2.0.12\KarambaCommon.dll")  # -> out, A, B; disabled
# ---------- c_script: C# ----------
    Dictionary<string, List<int>> myDict = new Dictionary<string, List<int>>();
    List < int> nums = new List<int>(){0,1,2,3,4,5};
    for(int i = 0;i < nums.Count;i++)
    {
      myDict.Add(i.ToString(), new List<int>(){i});
    }
    //    myDict.Clear();
    int a = 10;
    double b = 5016134851.09854;
    double c = Math.Pow(a, 7);
    A = b/c;
# ---------- end c_script ----------
panel_4 = Panel(test2.A)  # disabled
number_slider = Slider(3, range=0..10)  # disabled
panel_5 = Panel(test1.A)  # disabled
panel_6 = Panel(c_script.A)  # disabled
pop2d = Populate2D(Region={Plane=PlaneXY(0, 0, 0), Size=Domain2(u=0..20, v=0..10)}, Count=number_slider, Seed=1)  # disabled
test3 = CSharpScript(x=pop2d)  # -> out, A; inputs x: list of Point3d; disabled
# ---------- test3: C# usings ----------
using System.Linq;
# ---------- test3: C# ----------
    List<Point3d> pt2 = new List<Point3d>(x);
    pt2.RemoveAt(0);
    pt2.Insert(pt2.Count , new Point3d(0, 0, 0));
    A = pt2;
# ---------- end test3 ----------
panel_7 = Panel(test3.A)  # disabled
