# Grasshopper definition 20220819_Working_Slab_example_KU.gh (Grasshopper 1.0.7)
# plug-ins: Kangaroo2 Components, Karamba3D, ICL.GH

# ---- group: Project Setup
# ICL
panel = Panel("\"Slab Test\"")
# ICL_V01: SlabSolver test
# ------------------------------------------
# ICL solver for Slab and column set up
# Github: https://github.com/KEERTHANAUDAY/ICL
modelinfo = CSharpScript(name=panel, projectNumber="\"00\"")  # -> ModelInfo; inputs name: String, projectNumber: String
# ---------- modelinfo: C# ----------
    List<string> projectInfo = new List<string>();
    projectInfo.Add(name);
    projectInfo.Add(projectNumber);

    ModelInfo = projectInfo;
# ---------- end modelinfo ----------

# ---- group: inputs
toggle = BooleanToggle(True)
list = ValueList({"Eurocode5"}, selected="Eurocode5")
list_2 = ValueList({"steel", "wood", "rcc": "RCC"}, selected="wood")
loadinfo = CSharpScript(gravitational=toggle, liveLoad=toggle)  # -> loadInfo; inputs gravitational: Boolean, liveLoad: Boolean
# ---------- loadinfo: C# ----------
    List<string> load = new List<string>();
    if (gravitational == true)
    {
      load.Add("gravitational");
    }
    if (liveLoad == true)
    {
      load.Add("liveLoad");
    }
    loadInfo = load;
# ---------- end loadinfo ----------
supportinfo = CSharpScript(number=Slider(8, range=0..10))  # -> supportInfo; inputs number: Int32
# ---------- supportinfo: C# ----------
    supportInfo = number;
# ---------- end supportinfo ----------
materialproperties = CSharpScript(type=list_2, code=list)  # -> materialInfo; inputs type: String, code: String
# ---------- materialproperties: C# ----------
    List<string> material = new List<string>();
    material.Add(type);
    material.Add(code);
    materialInfo = material;
# ---------- end materialproperties ----------
crv = Curve(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)

# ---- group: Test Scripts / test to finid mesh neighbours in RH
mesh = Mesh(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)  # disabled
findmeshneighbourstest = CSharpScript(mesh=mesh)  # -> out, A, B; inputs mesh: Mesh; disabled
# ---------- findmeshneighbourstest: C# ----------
    //    List<Point3d> meshVertices = new List<Point3d>();
    //    foreach(Point3d v in mesh.Vertices)
    //    {
    //      meshVertices.Add(v);
    //    }
    List<Point3d> testVList = new List<Point3d>();
    foreach(Point3d pt in mesh.Vertices)
    {
      testVList.Add(pt);
    }
      
    int[] meshVind = mesh.TopologyVertices.ConnectedTopologyVertices(400);
    List<Point3d> connectedPoints = new List<Point3d>();
    foreach(int i in meshVind)
    {
      Point3d pt = mesh.Vertices.Point3dAt(i);
      connectedPoints.Add(pt);
    }
    A = connectedPoints;
    B = testVList;
# ---------- end findmeshneighbourstest ----------
panel_2 = Panel(findmeshneighbourstest.B)  # disabled
pt = Point(findmeshneighbourstest.A)  # disabled

# ---- group: Assembly
model = CSharpScript(nodes=supportinfo, elements=crv, loads=loadinfo, material=materialproperties)  # -> out, oNodes, oElements, oLoads, oMaterial; inputs Specs: list of String, nodes: list of Int32, elements: list of Curve, loads: list of String, material: list of String
# ---------- model: C# ----------
    oNodes = nodes;
    oElements = elements;
    oLoads = loads;
    oMaterial = material;
# ---------- end model ----------
cluster = Cluster(E=model.oElements)
pt_2 = Point([Point(0, 0, 0), Point(0, 500, 0), Point(500, 500, 0), Point(500, 0, 0)])

# ---- group: Test Scripts
mesh_2 = Mesh(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)  # disabled

# ---- group: Test Scripts / Mesh3 to Mesh test
triremesh = TriRemesh(Geometry=mesh_2, Iterations=25)  # -> Triangulation, Dual, Creases; disabled
meshtomesh3 = CSharpScript(
    x=triremesh.Triangulation,
    Reference=["C:\Users\ukeer\AppData\Roaming\McNeel\Rhinoceros\packages\7.0\Karamba3D\2.2.0.12\KarambaCommon.dll", "C:\Users\ukeer\AppData\Roaming\McNeel\Rhinoceros\packages\7.0\Karamba3D\2.2.0.12\karamba.gha"])  # -> out, A, C; inputs x: Mesh; disabled
# ---------- meshtomesh3: C# usings ----------
using Karamba.Geometry;
using Karamba.GHopper;
# ---------- meshtomesh3: C# ----------
    Mesh3 kMesh = new Mesh3();
    foreach(MeshFace f in x.Faces)
    {
      kMesh.AddFace(f.A, f.B, f.C);
    }
    foreach(Point3d v in x.Vertices)
    {
      kMesh.AddVertex(new Point3(v.X, v.Y, v.Z));
    }
    
    Mesh rMesh = new Mesh();
    foreach(var f in kMesh.Faces)
    {
      rMesh.Faces.AddFace(f.A, f.B, f.C);
    }
    
    foreach(Point3 v in kMesh.Vertices)
    {
      rMesh.Vertices.Add(new Point3d(v.X, v.Y, v.Z));
    }
    
    List < Point3d > testPt = new List<Point3d>();
  
    Point3d v1 = rMesh.Vertices.Point3dAt(rMesh.Faces[300].A);
    Point3d v2 = rMesh.Vertices.Point3dAt(rMesh.Faces[300].B);
    Point3d v3 = rMesh.Vertices.Point3dAt(rMesh.Faces[300].C);
    testPt.Add(v1);
    testPt.Add(v2);
    testPt.Add(v3);



    C = rMesh;
    A = testPt;
# ---------- end meshtomesh3 ----------
mesh_3 = Mesh(meshtomesh3.C)  # disabled
pt_3 = Point(meshtomesh3.A)  # disabled
panel_3 = Panel(meshtomesh3.A)  # disabled

# ---- group: ICL_model_assembly
initializeabmmodel = CSharpScript(
    iNcolumns=model.oNodes,
    iEnvironmentGeo=model.oElements,
    iEnvironmentSrfGeo=cluster,
    iEnvironmentGeoPoints=pt_2,
    iLoads=model.oLoads,
    iMaterial=model.oMaterial,
    Reference=["C:\Users\ukeer\AppData\Roaming\McNeel\Rhinoceros\packages\7.0\Karamba3D\2.2.0.12\karamba.gha", "C:\Users\ukeer\AppData\Roaming\Grasshopper\Libraries\ICD.AbmFramework.Core.dll", "C:\Users\ukeer\AppData\Roaming\McNeel\Rhinoceros\packages\7.0\Karamba3D\2.2.0.12\karamba.dll", "C:\Users\ukeer\AppData\Roaming\McNeel\Rhinoceros\packages\7.0\Karamba3D\2.2.0.12\KarambaCommon.dll", "C:\Users\ukeer\GitHub\ICL\ICL.Core\obj\Release\ICL.Core.dll"])  # -> out, oAgentStartPos, oStartNodalDisplacement, oMaxDispBehavior, oCartesianAgents, oEnvironmentStart, CAS; inputs iNcolumns: Int32, iEnvironmentGeo: Curve, iEnvironmentSrfGeo: Mesh, iEnvironmentGeoPoints: list of Point3d, iLoads: list of String, iMaterial: list of String
# ---------- initializeabmmodel: C# usings ----------
using ICL.Core.Utilities;
using ICL.Core.Environment;
using ICL.Core.StructuralModelling;
using ICL.Core.AgentBehaviors;
using ICL.Core.AgentSystem;
using ICL.Core.ICLsolver;

using Karamba.Materials;
using Karamba.Geometry;
using Karamba.Elements;
using Karamba.CrossSections;
using Karamba.Supports;
using Karamba.Loads;
using Karamba.Models;
using Karamba.GHopper;
using Karamba.GHopper.Geometry;
using KarambaCommon;
using Karamba.Utilities;
using System.Linq;

using ICD.AbmFramework.Core;
using ICD.AbmFramework.Core.Behavior;
using ICD.AbmFramework.Core.AgentSystem;
using ICD.AbmFramework.Core.Agent;
using ICD.AbmFramework.Core.Environments;
# ---------- initializeabmmodel: C# ----------
    //COMPUTE START POSITIONS
    Mesh3 kSlabMesh = iEnvironmentSrfGeo.Convert();
    SlabInitializeAgents initializeAgents = new SlabInitializeAgents(iNcolumns, iEnvironmentGeo, iEnvironmentSrfGeo);
    initializeAgents.ComputeColumnStartPosSlab();
    List<Point3d> agentStartPositions = initializeAgents.ColumnStartPos;

    //COMPUTE NODAL DISPLACEMENTS OF THE ENVIRONMENT & DEFINE ICLSlabcartesianEnvironment
    ICLslabCartesianEnvironment environment = new ICLslabCartesianEnvironment(agentStartPositions, iEnvironmentGeoPoints, kSlabMesh, iLoads, iMaterial);
    environment.Execute();
    Dictionary<int, List<Point3d>> startNodalDisplacements = environment.NodalDisplacement;

    //DEFINE BEHAVIOR
    SlabMaxDisplacementBehavior maxDispBehavior = new SlabMaxDisplacementBehavior(iEnvironmentSrfGeo);
    maxDispBehavior.StartNodalDisplacemenets = startNodalDisplacements;
    List<BehaviorBase> agentBehaviors = new List<BehaviorBase>();
    agentBehaviors.Add(maxDispBehavior);

    //DEFINE CARTESIAN AGENTS
    List<CartesianAgent> cartesianAgents = new List<CartesianAgent>();
    foreach(Point3d pt in agentStartPositions)
    {
      CartesianAgent agent = new CartesianAgent(pt, agentBehaviors);
      cartesianAgents.Add(agent);
    }

    //DEFINE AGENT SYSTEM

    List<AgentSystemBase> casSystems = new List<AgentSystemBase>();
    ICLslabCartesianAgentSystem csSystem = new ICLslabCartesianAgentSystem(cartesianAgents, environment);
    casSystems.Add(csSystem);

    //SOLVER
    SlabSolver testSlabSolver = new SlabSolver(casSystems);
    testSlabSolver.AgentSystems = casSystems;
    testSlabSolver.ICLslabSolverExecute();
    //    testSlabSolver.GetDisplayGeometries();

    //Output
    oAgentStartPos = agentStartPositions;
    oStartNodalDisplacement = startNodalDisplacements;
    oMaxDispBehavior = maxDispBehavior;
    oCartesianAgents = cartesianAgents;
    oEnvironmentStart = environment;
    CAS = casSystems;
    //    otest2 = nodes;
    //    otest3 = iEnvironmentSrfGeo.Vertices.Point3dAt(agentInd[0]);

    //testModel = new Karamba.GHopper.Models.GH_Model(test);
# ---------- end initializeabmmodel ----------
pt_4 = Point(initializeabmmodel.oAgentStartPos)
panel_4 = Panel(initializeabmmodel.oMaxDispBehavior)
panel_5 = Panel(initializeabmmodel.CAS)
panel_6 = Panel(initializeabmmodel.oStartNodalDisplacement)
panel_7 = Panel(initializeabmmodel.oCartesianAgents)
panel_8 = Panel(initializeabmmodel.oEnvironmentStart)

# ---- group: Solver
slabsolver = MyComponent1(Reset=Toggle(True), Execute=Toggle(False), AgentSystems=initializeabmmodel.CAS)  # -> DisplayGeometries, AllAgentSystems, IterationCount

# ---- group: Test Scripts / testMeshSearch
mesh_4 = Mesh(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)  # disabled
pt_5 = Point([Point(0, 0, 0), Point(241.1613464, 0, 0), Point(500, 0, 0), Point(500, 251.0764923, 0), Point(500, 500, 0), Point(263.7160339, 500, 0), Point(0, 500, 0), Point(0, 250.9857635, 0)])  # disabled
testformeshsearch = CSharpScript(mesh=mesh_4, y=pt_5)  # -> out, A; inputs mesh: Mesh, y: list of Point3d; disabled
# ---------- testformeshsearch: C# ----------
    List<Point3d> test = FindNeighbours(y[1], mesh);
    
    A = test;
# ---------- testformeshsearch: C# additional code ----------
  public List<Point3d> FindNeighbours(Point3d knownxyz, Mesh mesh)
  {
    List<int> foundIndex = new List<int>();
    for(int i = 0; i < mesh.Vertices.Count; i++)
    {
      if(knownxyz.EpsilonEquals(mesh.TopologyVertices[i], 0.001))
      {
        foundIndex.Add(i);
      }
    }
    int[] meshVind = mesh.TopologyVertices.ConnectedTopologyVertices(foundIndex[0]);
    List<Point3d> connectedPoints = new List<Point3d>();
    foreach(int i in meshVind)
    {
      Point3d pt = mesh.Vertices.Point3dAt(i);
      connectedPoints.Add(pt);
    }
    return connectedPoints;
  }
# ---------- end testformeshsearch ----------
panel_9 = Panel(testformeshsearch.A)  # disabled

# ---- group: Visualization
visualization = CSharpScript(
    iAgentSystem=slabsolver.AllAgentSystems,
    Reference=["C:\Users\ukeer\AppData\Roaming\Grasshopper\Libraries\ICD.AbmFramework.Core.dll", "C:\Users\ukeer\AppData\Roaming\McNeel\Rhinoceros\packages\7.0\Karamba3D\2.2.0.12\karamba.gha", "C:\Users\ukeer\AppData\Roaming\McNeel\Rhinoceros\packages\7.0\Karamba3D\2.2.0.12\KarambaCommon.dll", "C:\Users\ukeer\AppData\Roaming\McNeel\Rhinoceros\packages\7.0\Karamba3D\2.2.0.12\karamba.dll", "C:\Users\ukeer\GitHub\ICL\ICL.Core\bin\Debug\ICL.Core.dll"])  # -> out, oAgentPositions, oEnvDisp, oModel, OcheckNeighbourVal
# ---------- visualization: C# usings ----------
using ICL.Core.AgentSystem;
using ICL.Core.Environment;
using ICD.AbmFramework.Core.Agent;
using ICD.AbmFramework.Core.AgentSystem;
using ICL.Core.AgentBehaviors;

using Karamba.Models;
using Karamba.GHopper;
# ---------- visualization: C# ----------
    agentSystem = (ICLslabCartesianAgentSystem) iAgentSystem;

    //add agent positions into a list
    List<Point3d> agentPositions = new List<Point3d>();
    foreach (CartesianAgent agent in agentSystem.Agents)
      agentPositions.Add(agent.Position);

    //get nodal displacements to a dict
    Dictionary<int, List<Point3d>> nodalDisp = agentSystem.CartesianEnvironment.NodalDisplacement;
    List<double> displacementsZ = new List<double>();
    List<Point3d> displacements = new List<Point3d>();
    foreach(List<Point3d> pts in  nodalDisp.Values)
    {
      displacementsZ.Add(pts[1][2]);
      Point3d pt = new Point3d(pts[1][0], pts[1][1], pts[1][2] * 1000000000);
      displacements.Add(pt);
    }
    //    Polyline pLine = new Polyline(displacements);

    List<double> checkNeighbourVal = new List<double>();

    foreach (CartesianAgent agent in agentSystem.Agents)
    {
      foreach(SlabMaxDisplacementBehavior behavior in agent.Behaviors)
      {
        foreach(Point3d vPt in behavior.VertexNeighbours)
        {
          checkNeighbourVal.Add(vPt.Z);
        }
      }
    }

    Model model = agentSystem.CartesianEnvironment.SlabModel;

    oModel = new Karamba.GHopper.Models.GH_Model(model);
    oAgentPositions = agentPositions;
    oEnvDisp = displacements;
    OcheckNeighbourVal = checkNeighbourVal;
# ---------- visualization: C# additional code ----------
  private ICLslabCartesianAgentSystem agentSystem;

  public override void DrawViewportMeshes(IGH_PreviewArgs args)
  {

  }
# ---------- end visualization ----------
pt_6 = Point(visualization.oAgentPositions)
modelview = ModelViewKaramba3D(Model=visualization.oModel, ResultFactors=1, ResultCase=-1)  # -> Model, DeformedMesh, DeformedAxes, DeformedModel
shellview = ShellViewKaramba3D(Model=modelview.Model, IndexOfLayer=0)  # -> Model, MeshesOfRenderedShells, LegendColors, LegendTags
legend = Legend(Colour=shellview.LegendColors, Tags=shellview.LegendTags, LegendType=1)
mesh_5 = Mesh(shellview.MeshesOfRenderedShells)
preview = CustomPreview(Geometry=mesh_5, Material=ColourSwatch(SwatchColor=RGBA(243, 255, 126, 0)))

# ---- group: Test Scripts / Visualization
brep = Brep(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)  # disabled
pt_7 = Point(Point(0, 0, 0))  # disabled
vizualizationobjects = GhPythonScript(x=brep, brep_X=pt_7)  # -> out, disp_geo, id1, id2, id3; inputs points: list of Point3d, x: Brep, brep_X: Point3d; disabled
# ---------- vizualizationobjects: Python ----------
__author__ = "ukeer"
__version__ = "2022.05.17"

import rhinoscriptsyntax as rs
import Rhino.Geometry as rg
import scriptcontext as sc


#geometry_pos = []
#for pt in points: 
#    vec = rs.VectorSubtract(rs.CreatePoint(pt[0], pt[1], (pt[2]-(0.3/2))), pt)
#    vec.Unitize()
#    
#    new_pos = rs.VectorAdd(pt, rs.VectorScale(vec, (0.3/2)))
#    geometry_pos.append(new_pos)

b_centroid = rg.AreaMassProperties.Compute(x).Centroid
b_plane = rs.CreatePlane(brep_X, (1.0, 0.0, 0.0), (0.0, 1.0, 0.0))


#vec transform for roller

vec_roller1 = points[0] - brep_X
xf1 = rg.Transform.Translation(vec_roller1)
brep_guid1 = sc.doc.Objects.AddBrep(x)
id1 = sc.doc.Objects.Transform(brep_guid1, xf1, False)

vec_roller2 = points[1] - brep_X
xf2 = rg.Transform.Translation(vec_roller2)
brep_guid2 = sc.doc.Objects.AddBrep(x)
id2 = sc.doc.Objects.Transform(brep_guid2, xf2, False)

vec_roller3 = points[2] - brep_X
xf3 = rg.Transform.Translation(vec_roller3)
brep_guid3 = sc.doc.Objects.AddBrep(x)
id3 = sc.doc.Objects.Transform(brep_guid3, xf3, False)
# ---------- end vizualizationobjects ----------
swatch = ColourSwatch(SwatchColor=RGBA(9, 18, 115, 171))  # disabled
preview_2 = CustomPreview(Geometry=[vizualizationobjects.id1, vizualizationobjects.id2, vizualizationobjects.id3], Material=swatch)  # disabled

# ==== cluster Cluster
E = ClusterInput()
boundary = BoundarySurfaces(Edges=E)
mesh_breps = MeshBrepsKaramba3D(
    Brep=boundary,
    MeshResolution=Slider(500, range=0..500),
    EdgeRefinementFactor=0.67,
    PointReduction=False,
    SmoothingStepSize=0,
    SmoothingIterations=5)  # -> Mesh, Info
triremesh = TriRemesh(Geometry=mesh_breps.Mesh, Iterations=25)  # -> Triangulation, Dual, Creases
T = ClusterOutput(triremesh.Triangulation)
