# Grasshopper definition 20220819_working_beam_test_KU.gh (Grasshopper 1.0.7)
# plug-ins: Karamba3D, ICL.GH

# ---- group: Project Setup
modelinfo = CSharpScript(name="\"3beamtest\"", projectNumber="\"00\"")  # -> ModelInfo; inputs name: String, projectNumber: String
# ---------- modelinfo: C# ----------
    List<string> projectInfo = new List<string>();
    projectInfo.Add(name);
    projectInfo.Add(projectNumber);

    ModelInfo = projectInfo;
# ---------- end modelinfo ----------

# ---- group: Define Project Parameters
toggle = BooleanToggle(True)
list = ValueList({"Eurocode"}, selected="Eurocode")
list_2 = ValueList({"steel", "wood", "rcc": "RCC"}, selected="wood")
line = Line(Line((0, 0, 0), (1500, 0, 0)))
loadinfo = CSharpScript(gravitational=toggle, liveLoad=toggle)  # -> loadInfo; inputs gravitational: Boolean, liveLoad: Boolean
# ---------- loadinfo: C# ----------
    List<string> load = new List<string>();
    if (gravitational == true)
    {
      load.Add("gravitational");
    }
    if (liveLoad == true)
    {
      load.Add("liveLoad");
    }
    loadInfo = load;
# ---------- end loadinfo ----------
supportinfo = CSharpScript(number=Slider(3, range=0..10))  # -> supportInfo; inputs number: Int32
# ---------- supportinfo: C# ----------
    supportInfo = number;
# ---------- end supportinfo ----------
materialproperties = CSharpScript(type=list_2, code=list)  # -> materialInfo; inputs type: String, code: String
# ---------- materialproperties: C# ----------
    List<string> material = new List<string>();
    material.Add(type);
    material.Add(code);
    materialInfo = material;
# ---------- end materialproperties ----------
beamgeo = CSharpScript(line=line)  # -> beamGeo; inputs line: Line
# ---------- beamgeo: C# ----------
    List<Point3d> linePoints = new List<Point3d>();
    Point3d lineStart = line.PointAt(1);
    Point3d lineEnd = line.PointAt(0);
    linePoints.Add(lineStart);
    linePoints.Add(lineEnd);
    beamGeo = linePoints;
# ---------- end beamgeo ----------

# ----
panel = Panel(line)

# ---- group: Assembly
model = CSharpScript(Specs=modelinfo, nodes=supportinfo, elements=beamgeo, loads=loadinfo, material=materialproperties)  # -> out, oNodes, oElements, oLoads, oMaterial; inputs Specs: list of String, nodes: list of Int32, elements: list of Point3d, loads: list of String, material: list of String
# ---------- model: C# ----------
    oNodes = nodes;
    oElements = elements;
    oLoads = loads;
    oMaterial = material;
# ---------- end model ----------

# ----
python = GhPythonScript(x=line)  # -> out, a; inputs x: Line
# ---------- python: Python ----------
__author__ = "ukeer"
__version__ = "2022.06.16"

import rhinoscriptsyntax as rs

print(x.Length)
# ---------- end python ----------
panel_2 = Panel(model.oMaterial)
pt = Point([Point(1500, 0, 0), Point(0, 0, 0)])
iclcoretest = CSharpScript(
    environmentGeo=model.oElements,
    columnNumbers=model.oNodes,
    iLoads=model.oLoads,
    iMaterial=model.oMaterial,
    Reference=["C:\Users\ukeer\AppData\Roaming\Grasshopper\Libraries\ICD.AbmFramework.Core.dll", "C:\Users\ukeer\AppData\Roaming\McNeel\Rhinoceros\packages\7.0\Karamba3D\2.2.0.12\karamba.dll", "C:\Users\ukeer\AppData\Roaming\McNeel\Rhinoceros\packages\7.0\Karamba3D\2.2.0.12\KarambaCommon.dll", "C:\Users\ukeer\AppData\Roaming\McNeel\Rhinoceros\packages\7.0\Karamba3D\2.2.0.12\karamba.gha", "C:\Users\ukeer\GitHub\ICL\ICL.Core\bin\Debug\ICL.Core.dll"])  # -> out, A, B, C, D, E, CAS, G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; inputs environmentGeo: list of Point3d, columnNumbers: Int32, iLoads: list of String, iMaterial: list of String
# ---------- iclcoretest: C# usings ----------
using System.Linq;

using ICL;
using ICL.Core;
using ICL.Core.Utilities;
using ICL.Core.Environment;
using ICL.Core.AgentBehaviors;
using ICL.Core.ICLsolver;
using ICL.Core.Utilities;
using ICL.Core.Environment;
using ICL.Core.AgentSystem;

using Karamba.Geometry;
using Karamba.Materials;
using Karamba.Supports;
using KarambaCommon;
using Karamba.CrossSections;
using Karamba.Elements;
using Karamba.Loads;
using Karamba.Models;

using ICD.AbmFramework.Core;
using ICD.AbmFramework.Core.Behavior;
using ICD.AbmFramework.Core.AgentSystem;
using ICD.AbmFramework.Core.Agent;
using ICD.AbmFramework.Core.Environments;
# ---------- iclcoretest: C# ----------
    //COMPUTE COOLUMN START POSITONS
    BeamInitializeAgents agentStart = new BeamInitializeAgents(columnNumbers, environmentGeo);
//    List<Point3d> agentStartPos = agentStart.ComputeColumnStartPos();
    List<Point3d> agentStartPos = new List<Point3d>();
    Point3d pt1 = new Point3d(900, 0, 0);
    Point3d pt2 = new Point3d(850, 0, 0);
    Point3d pt3 = new Point3d(100, 0, 0);
    agentStartPos.Add(pt1);
    agentStartPos.Add(pt2);
    agentStartPos.Add(pt3);

    //COMPUTE NODAL DISPLACEMENTS OF THE ENVIRONMENT & DEFINE ICLcartesianEnvironment
    ICLcartesianEnvironment environmentStart = new ICLcartesianEnvironment(agentStartPos, environmentGeo, iLoads, iMaterial);
    environmentStart.Execute();
    Dictionary<int, List<Point3d>> startNodalDisplacement = environmentStart.NodalDisplacement;
    //    //temp test
    //    List<Point3d> tempDisp0 = new List<Point3d>();
    //    foreach(List<Point3d> points in startNodalDisplacement.Values)
    //    {
    //      RhinoApp.WriteLine(points.Count + "count");
    //      tempDisp0.Add(points[1]);
    //    }

    //DEFINE BEHAVIOR
    MaxDisplacementBehavior maxDispBehavior = new MaxDisplacementBehavior();
    maxDispBehavior.StartNodalDisplacemenets = startNodalDisplacement;
    List<BehaviorBase> agentBehaviors = new List<BehaviorBase>();
    agentBehaviors.Add(maxDispBehavior);

    //DEFINE CARTESIAN AGENTS
    List<CartesianAgent> cartesianAgents = new List<CartesianAgent>();
    foreach(Point3d pt in agentStartPos)
    {
      CartesianAgent agent = new CartesianAgent(pt, agentBehaviors);
      cartesianAgents.Add(agent);
    }

    //DEFINE AGENT SYSTEM

    List<AgentSystemBase> casSystems = new List<AgentSystemBase>();
    ICLcartesianAgentSystem csSystem = new ICLcartesianAgentSystem(cartesianAgents, environmentStart);
    casSystems.Add(csSystem);

    //SOLVER
    //    BeamSolver testBeamSolver = new BeamSolver(casSystems);
    //    testBeamSolver.AgentSystems = casSystems;
    //    testBeamSolver.ICLbeamSolverExecute();
    //    testBeamSolver.GetDisplayGeometries();
    //
    //    int testCount = testBeamSolver.IterationCount;

    //    Dictionary<int, List<Point3d>> testupdate = environmentStart.NodalDisplacement;

    //    List<Point3d> tempDisp = new List<Point3d>();
    //
    //    foreach(ICLcartesianAgentSystem asys  in testBeamSolver.AgentSystems)
    //    {
    //      foreach(CartesianAgent agent in asys.Agents)
    //      {
    //        tempDisp.Add(agent.Position);
    //      }
    //      Dictionary<int, List<Point3d>> testupdate = asys.CartesianEnvironment.NodalDisplacement;
    //
    //    foreach(List<Point3d> points in testupdate.Values)
    //    {
    //      RhinoApp.WriteLine(points.Count + "count");
    //      tempDisp.Add(points[1]);
    //    }
    //    }

    A = agentStartPos;
    B = startNodalDisplacement;
    C = maxDispBehavior;
    D = cartesianAgents;
    E = environmentStart;
    CAS = casSystems;
    //    G = testBeamSolver;
    //    H = testCount;
    //    I = testBeamSolver.tempDisp;
    //    J = tempDisp0;

    //1. Method not found: 'Void ICL.Core.AgentSystem.ICLcartesianAgentSystem..ctor(System.Collections.Generic.List`1<ICD.AbmFramework.Core.Agent.CartesianAgent>, ICL.Core.Environment.ICLcartesianEnvironment)'. (line: 124)
# ---------- end iclcoretest ----------
panel_3 = Panel(iclcoretest.G)
beamsolver = StepByStepSolver(Reset=Toggle(True), Execute=Toggle(False), AgentSystems=iclcoretest.CAS)  # -> DisplayGeometries, AllAgentSystems, IterationCount
pt_2 = Point(Point(0, 0, 0))
brep = Brep(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)
c_script = CSharpScript(
    iAgentSystem=beamsolver.AllAgentSystems,
    Reference=["C:\Users\ukeer\AppData\Roaming\Grasshopper\Libraries\ICD.AbmFramework.Core.dll", "C:\Users\ukeer\AppData\Roaming\McNeel\Rhinoceros\packages\7.0\Karamba3D\2.2.0.12\karamba.gha", "C:\Users\ukeer\AppData\Roaming\McNeel\Rhinoceros\packages\7.0\Karamba3D\2.2.0.12\KarambaCommon.dll", "C:\Users\ukeer\AppData\Roaming\McNeel\Rhinoceros\packages\7.0\Karamba3D\2.2.0.12\karamba.dll", "C:\Users\ukeer\GitHub\ICL\ICL.Core\bin\Debug\ICL.Core.dll"])  # -> out, oAgentPositions, oEnvDisp, oPline, oModel, OcheckNeighbourVal
# ---------- c_script: C# usings ----------
using ICL.Core.AgentSystem;
using ICD.AbmFramework.Core.Agent;
using ICD.AbmFramework.Core.AgentSystem;
using ICL.Core.AgentBehaviors;

using Karamba.Models;
using Karamba.GHopper;
# ---------- c_script: C# ----------
    agentSystem = (ICLcartesianAgentSystem) iAgentSystem;

    List<Point3d> agentPositions = new List<Point3d>();

    foreach (CartesianAgent agent in agentSystem.Agents)
      agentPositions.Add(agent.Position);

    Dictionary<int, List<Point3d>> nodalDisp = agentSystem.CartesianEnvironment.NodalDisplacement;
    List<double> displacementsZ = new List<double>();
    List<Point3d> displacements = new List<Point3d>();
    foreach(List<Point3d> pts in  nodalDisp.Values)
    {
      displacementsZ.Add(pts[1][2]);
      Point3d pt = new Point3d(pts[1][0], pts[1][1], pts[1][2] * 1000000000);
      displacements.Add(pt);
    }
    Polyline pLine = new Polyline(displacements);
    
    List<double> checkNeighbourVal = new List<double>();
    
    foreach (CartesianAgent agent in agentSystem.Agents)
    {
      foreach(MaxDisplacementBehavior behavior in agent.Behaviors)
      {
        checkNeighbourVal.Add(behavior.AncestorNodalDisp.Z);
        checkNeighbourVal.Add(behavior.DescendantNodalDisp.Z);
      }
    }

    Model model = agentSystem.CartesianEnvironment.BeamModel;
    
    oModel = new Karamba.GHopper.Models.GH_Model(model);
    oAgentPositions = agentPositions;
    oEnvDisp = displacements;
    oPline = pLine;
    OcheckNeighbourVal = checkNeighbourVal;
# ---------- c_script: C# additional code ----------
  private ICLcartesianAgentSystem agentSystem;

  public override void DrawViewportMeshes(IGH_PreviewArgs args)
  {

  }
# ---------- end c_script ----------
python_2 = GhPythonScript(points=c_script.oAgentPositions, x=brep, brep_X=pt_2)  # -> out, disp_geo, id1, id2, id3; inputs points: list of Point3d, x: Brep, brep_X: Point3d
# ---------- python_2: Python ----------
__author__ = "ukeer"
__version__ = "2022.05.17"

import rhinoscriptsyntax as rs
import Rhino.Geometry as rg
import scriptcontext as sc


#geometry_pos = []
#for pt in points: 
#    vec = rs.VectorSubtract(rs.CreatePoint(pt[0], pt[1], (pt[2]-(0.3/2))), pt)
#    vec.Unitize()
#    
#    new_pos = rs.VectorAdd(pt, rs.VectorScale(vec, (0.3/2)))
#    geometry_pos.append(new_pos)

b_centroid = rg.AreaMassProperties.Compute(x).Centroid
b_plane = rs.CreatePlane(brep_X, (1.0, 0.0, 0.0), (0.0, 1.0, 0.0))


#vec transform for roller

vec_roller1 = points[0] - brep_X
xf1 = rg.Transform.Translation(vec_roller1)
brep_guid1 = sc.doc.Objects.AddBrep(x)
id1 = sc.doc.Objects.Transform(brep_guid1, xf1, False)

vec_roller2 = points[1] - brep_X
xf2 = rg.Transform.Translation(vec_roller2)
brep_guid2 = sc.doc.Objects.AddBrep(x)
id2 = sc.doc.Objects.Transform(brep_guid2, xf2, False)

vec_roller3 = points[2] - brep_X
xf3 = rg.Transform.Translation(vec_roller3)
brep_guid3 = sc.doc.Objects.AddBrep(x)
id3 = sc.doc.Objects.Transform(brep_guid3, xf3, False)
# ---------- end python_2 ----------
preview = CustomPreview(Geometry=[python_2.id1, python_2.id2, python_2.id3], Material=ColourSwatch(SwatchColor=RGBA(9, 18, 115, 171)))
panel_4 = Panel(c_script.OcheckNeighbourVal)
panel_5 = Panel(c_script.oAgentPositions)
panel_6 = Panel(c_script.oPline)
panel_7 = Panel(c_script.oEnvDisp)
modelview = ModelViewKaramba3D(Model=c_script.oModel, ResultFactors=1, ResultCase=-1)  # -> Model, DeformedMesh, DeformedAxes, DeformedModel
beamview = BeamViewKaramba3D(Model=modelview.Model)  # -> Model, MeshesOfRenderedBeams, DeformedBeamAxes, LegendColors, LegendTags
legend = Legend(Colour=beamview.LegendColors, Tags=beamview.LegendTags, LegendType=1)
mesh = Mesh(beamview.MeshesOfRenderedBeams)
preview_2 = CustomPreview(Geometry=mesh, Material=ColourSwatch(SwatchColor=RGBA(243, 255, 126, 0)))
