# Grasshopper definition 240326-Karamba-ABM.gh (Grasshopper 1.0.7)
# plug-ins: Karamba3D, ABxM.Grasshopper, ICL.GH

# ---- group: Columns
column_count = Slider(48, range=0..100)
floorboundary = Curve(reparameterize(<curve referenced from the Rhino model>))
columns = Point(flatten([<point referenced from the Rhino model> x48]))
support_walls = Curve(<curve referenced from the Rhino model>)

# ----
boundary = BoundarySurfaces(Edges=floorboundary)
explode = Explode(Curve=support_walls, Recursive=True)  # -> Segments, Vertices
panel = Panel("""10
5
10
5""")
divide = DivideCurve(Curve=explode.Segments, Count=panel, Kinks=False)  # -> flatten(Points), Tangents, Parameters

# ---- group: Mesh
mesh_breps = MeshBreps(
    Brep=boundary,
    InclusionPoints=flatten([divide.Points, columns]),
    MeshResolution=Slider(0.5, range=0..1),
    EdgeRefinementFactor=Slider(1, range=0..1),
    PointReduction=False,
    SmoothingStepSize=0.8,
    SmoothingIterations=5)  # -> Mesh, Info
mesh = Mesh(mesh_breps.Mesh)

# ---- group: Material
matselect = MaterialSelectionKaramba3D(menu=[dropdown(1), dropdown(2)])
matprops = MaterialPropertiesKaramba3D(
    FamilyOfMaterial="Solid Timber",
    Name="S235",
    ElementIdentifier="CLT_timber",
    YoungsModulusOfElasticity="1155",
    InPlaneShearModulus_kN_cm2="69",
    TransverseShearModulus_kN_cm2="28.3",
    SpecificWeight_kN_m3="5.50",
    CoefficientOfThermalExpansion_1_C=1.2e-05,
    TensileStrength_kN_cm2="1.4",
    CompressiveStrength_kN_cm2="-2.1",
    StrengthHypothesis="MISES",
    mode="Isotrop")
matselect_2 = MaterialSelectionKaramba3D(menu=[dropdown(7), dropdown(5)])

# ---- group: ColumnStartPoints
divide_2 = DivideCurve(Curve=floorboundary, Count=column_count, Kinks=False)  # -> Points, Tangents, Parameters
demesh = DeconstructMesh(Mesh=mesh)  # -> Vertices, Faces, Colours, Normals
cp = ClosestPoint(Point=divide_2.Points, Cloud=demesh.Vertices)  # -> ClosestPoint, CPIndex, Distance

# ---- group: CrossSection
cross_section = CrossSectionKaramba3D(FamilyNameOfCrossSection="slab", Material=matselect_2, Height_cm="30", mode="Shell - Const")

# ----
disc = Discontinuity(Curve=floorboundary, Level=1)  # -> Points, Parameters
pt = Point(disc.Points)
c_script = CSharpScript(iMesh=mesh, iColumns=columns)  # -> out, oVertexColumns; inputs iMesh: Mesh, iColumns: list of Point3d
# ---------- c_script: C# ----------
    List<Point3d> vertices = new List<Point3d>();
    PointCloud cloud = new PointCloud();
    List<Point3d> closestPoints = new List<Point3d>();
    foreach (Point3d vertex in iMesh.Vertices)
    {
      vertices.Add(vertex);
      cloud.Add(vertex);
    }
    foreach (Point3d column in iColumns)
    {
      int closestIndex = cloud.ClosestPoint(column);
      Point3d closestPoint = cloud[closestIndex].Location;
      closestPoints.Add(closestPoint);
    }
    oVertexColumns = closestPoints;
# ---------- end c_script ----------
c_script_2 = CSharpScript(
    K="Type",
    V="web",
    Reference="C:\USERS\LUI-O\APPDATA\ROAMING\MCNEEL\RHINOCEROS\PACKAGES\7.0\ABXM-CORE\1.5.4\ABxM.Core.dll")  # -> out, A; inputs K: String, V: list
# ---------- c_script_2: C# usings ----------
using ABxM.Core.Agent;
# ---------- c_script_2: C# ----------
    List<Dictionary<string, object>> customData = new List<Dictionary<string, object>>();

    foreach(object myValue in V)
    {
      Dictionary<string, object> myData = new Dictionary<string, object>();
      myData.Add(K, myValue);
      customData.Add(myData);
    }


    A = customData;
# ---------- c_script_2: C# additional code ----------
  /// <summary>
  /// This method will be called once every solution, before any calls to RunScript.
  /// </summary>
  public override void BeforeRunScript()
  { }
  /// <summary>
  /// This method will be called once every solution, after any calls to RunScript.
  /// </summary>
  public override void AfterRunScript()
  { }
# ---------- end c_script_2 ----------

# ---- group: Define elements
meshtoshell = MeshToShellKaramba3D(Mesh=mesh, Identifier="Shell_1", CrossSection=cross_section, LimitDistance_m=0.005)  # -> Element, Points, Info

# ----
field_columns = Point(c_script.oVertexColumns)
core_wall = Point(divide.Points)
c_script_3 = CSharpScript(
    iBoundaryCorners=pt,
    iMesh=mesh,
    Reference="C:\USERS\LUI-O\APPDATA\ROAMING\MCNEEL\RHINOCEROS\PACKAGES\7.0\ABXM-CORE\1.5.4\ABxM.Core.dll")  # -> out, oEnvironment; inputs iBoundaryCorners: list of Point3d, iMesh: Mesh
# ---------- c_script_3: C# usings ----------
using System.IO;
using System.Linq;
using System.Data;
using System.Drawing;
using System.Reflection;
using System.Windows.Forms;
using System.Xml;
using System.Xml.Linq;
using System.Runtime.InteropServices;

using Rhino.DocObjects;
using Rhino.Collections;
using GH_IO;
using GH_IO.Serialization;
using ABxM.Core;
using ABxM.Core.Utilities;
using ABxM.Core.Environments;
using ABxM.Core.Behavior;
using ABxM.Core.Agent;
using ABxM.Core.AgentSystem;
# ---------- c_script_3: C# ----------
    Dictionary < string, object > displDict = new Dictionary<string, object>();
    for (int i = 0; i < iMesh.Vertices.Count(); i++)
    {
      displDict.Add(i.ToString(), i);
    }
    oEnvironment = new CartesianEnvironment(iBoundaryCorners){CustomData = displDict};
# ---------- end c_script_3 ----------
simple_maxdisplbeh = CSharpScript(Reference="C:\USERS\LUI-O\APPDATA\ROAMING\MCNEEL\RHINOCEROS\PACKAGES\7.0\ABXM-CORE\1.5.4\ABxM.Core.dll")  # -> out, oBehavior
# ---------- simple_maxdisplbeh: C# usings ----------
using Rhino.Collections;
using Rhino.DocObjects;
using GH_IO;
using GH_IO.Serialization;

using ABxM.Core;
using ABxM.Core.Agent;
using ABxM.Core.AgentSystem;
using ABxM.Core.Behavior;
using ABxM.Core.Environments;
using ABxM.Core.Utilities;
# ---------- simple_maxdisplbeh: C# ----------
    oBehavior = behavior;
# ---------- simple_maxdisplbeh: C# additional code ----------
  MaxDispBehavior behavior = new MaxDispBehavior();

  public class MaxDispBehavior : BehaviorBase
  {
    public Mesh EnvMesh;
    public CartesianEnvironment Environment;


    public MaxDispBehavior()
    {
      Weight = 1.0;
    }

    public override void Execute(AgentBase agent)
    {
      CartesianAgent cartesianAgent = (CartesianAgent) agent;
      if (cartesianAgent == null) return;
      CartesianAgentSystem system = (CartesianAgentSystem) (cartesianAgent.AgentSystem);
      if (system == null) return;
      CartesianEnvironment environment = (CartesianEnvironment) (system.CartesianEnvironment);
      // the environment is set in the custom code

      // get displacement info from the environment
      Dictionary<int, Point3d> originalPointDict = new Dictionary<int, Point3d>();
      Dictionary<int, Point3d> displacedPointDict = new Dictionary<int, Point3d>();

      foreach (KeyValuePair<string, object> kvp in Environment.CustomData)
      {
        int key = int.Parse(kvp.Key);
        var nodeData = (Tuple<Point3d, Point3d>) kvp.Value;
        originalPointDict[key] = nodeData.Item1;
        displacedPointDict[key] = nodeData.Item2;
      }

      //// Find the index of the agent's position in the mesh's topology vertices
      // Convert Point3d to Point3f
      Point3f agentPositionF = new Point3f((float) cartesianAgent.Position.X, (float) cartesianAgent.Position.Y, (float) cartesianAgent.Position.Z);
      // Define a tolerance for comparing points
      float tolerance = 0.01f;
      // Find the index of the agent's position in the mesh's topology vertices
      int agentPositionIndex = -1;

      for (int i = 0; i < EnvMesh.TopologyVertices.Count; i++)
      {
        Point3f vertex = EnvMesh.TopologyVertices[i];
        if (vertex.DistanceTo(agentPositionF) < tolerance)
        {
          agentPositionIndex = i;
          break;
        }
      }

      if (agentPositionIndex == -1) return;

      // Create a dictionary to hold the neighbors and their displacements
      Dictionary<string, object> neighborTuple = new Dictionary<string, object>();
      Dictionary<int, List<Point3d>> neighborNodes = new Dictionary<int, List<Point3d>>();
      Dictionary<int, List<Point3d>> displacedNeighborNodes = new Dictionary<int, List<Point3d>>();
      List<Point3d> meshNeighbors = new List<Point3d>();
      int[] meshNeighborIndexes = EnvMesh.TopologyVertices.ConnectedTopologyVertices(agentPositionIndex);
      foreach (int index in meshNeighborIndexes)
      {
        meshNeighbors.Add(EnvMesh.Vertices.Point3dAt(index));
      }
      foreach (Point3d meshPoint in meshNeighbors)
      {
        foreach (KeyValuePair<string, object> kvp in Environment.CustomData)
        {
          var nodeData = (Tuple<Point3d, Point3d>) kvp.Value;
          if (meshPoint == nodeData.Item1)
          {
            neighborTuple.Add(kvp.Key, kvp.Value);
          }
        }
      }

      // Get vector to move towards max displacement
      Point3d targetVertex = Point3d.Unset;
      double maxZ = double.MinValue;

      foreach (KeyValuePair<string, object> kvp in neighborTuple)
      {
        var nodeData = (Tuple<Point3d, Point3d>) kvp.Value;
        if (Math.Abs(nodeData.Item2.Z) > maxZ)
        {
          targetVertex = nodeData.Item1;
          maxZ = Math.Abs(nodeData.Item2.Z);
        }
      }

      if (targetVertex != Point3d.Unset)
      {
        // Create a vector that points from the agent's current position to the target vertex
        Vector3d moveVec = targetVertex - cartesianAgent.Position;
        // Apply the moveVec to the agent's position
        cartesianAgent.Moves.Add(moveVec);
        cartesianAgent.Weights.Add(Weight);
      }

    }
  }
# ---------- end simple_maxdisplbeh ----------

# ---- group: Supports
supp = SupportKaramba3D(PosInd=flatten(field_columns), menu=[buttons(on, on, on, off, off, off)])
supp_2 = SupportKaramba3D(PosInd=flatten(core_wall), menu=[buttons(on, on, on, off, off, on)])
support = SupportKaramba3D(flatten([supp, supp_2]))

# ----
icl_max_displ = DefineColumnMaximumDisplacementBehavior(Weight=Slider(1, range=0..1))
panel_2 = Panel(c_script_3.out)
cartesian_agent = DefineCartesianAgent(Positions=cp.ClosestPoint, Behaviors=icl_max_displ)
number_slider = Slider(0, range=0..2)
support_2 = SupportKaramba3D(flatten(supp_2))

# ---- group: Loads
panel_3 = Panel("3")
Z = UnitZ(Factor="-1")
loads = LoadsKaramba3D(Vector=Z, LCase="0", mode="Gravity")

# ----
Z_2 = UnitZ(Factor=panel_3)
rev = Reverse(Vector=Z_2)

# ---- group: Loads (continued)
loads_2 = LoadsKaramba3D(Vector=rev, Mesh=mesh, LCase="0", mode="MeshLoad -Const.", menu=[buttons(off, off, on), buttons(on, on)])
load = LoadKaramba3D(flatten([loads, loads_2]))

# ---- group: Analyse Model
assemble = AssembleModelKaramba3D(Elem=flatten(meshtoshell.Element), Support=flatten(support), Load=flatten(load), LimitDistance_m=0.005)  # -> Model, Info, Mass_kg, CenterOfGravity, LoadCaseNames
analyze = AnalyzeKaramba3D(Model=assemble.Model)  # -> CalculatedModel, MaximumDisplacement_cm, ResultingForceOfGravity_kN, ElasticEnergy_kNm
panel_4 = Panel(analyze.MaximumDisplacement_cm)

# ----
c_script_4 = CSharpScript(
    iEnv=c_script_3.oEnvironment,
    iAgents=cartesian_agent,
    iDiagram=number_slider,
    iElem=meshtoshell.Element,
    iSupports=support_2,
    iLoads=load,
    Reference=["C:\Program Files\Rhino 7\Plug-ins\Karamba\karamba.gha", "C:\Program Files\Rhino 7\Plug-ins\Karamba\karambaCommon.dll", "C:\Users\lui-o\AppData\Roaming\Grasshopper\Libraries\ICL.Core.dll", "C:\Program Files\Rhino 7\Plug-ins\Karamba\karamba.dll", "C:\Users\lui-o\AppData\Roaming\McNeel\Rhinoceros\packages\7.0\ABxM-Core\1.5.4\ABxM.Core.dll"])  # -> out, oAgentSystem; inputs iAgents: list, iDiagram: Int32, iElem: list, iSupports: list, iLoads: list
# ---------- c_script_4: C# usings ----------
using System.Data;
using System.Drawing;
using System.IO;
using System.Linq;
using System.Reflection;
using System.Runtime.InteropServices;
using System.Xml;
using System.Xml.Linq;

using Rhino.Collections;
using Rhino.DocObjects;
using Grasshopper.Kernel.Geometry;
using Grasshopper.Kernel.Geometry.Delaunay;
using Grasshopper.Kernel.Geometry.Voronoi;
using GH_IO;
using GH_IO.Serialization;

using ABxM.Core;
using ABxM.Core.Agent;
using ABxM.Core.AgentSystem;
using ABxM.Core.Behavior;
using ABxM.Core.Environments;
using ABxM.Core.Utilities;

using ICL.Core;
using ICL.Core.AgentBehaviors;
using ICL.Core.AgentSystem;
using ICL.Core.Environment;
using ICL.Core.ICLsolver;
using ICL.Core.StructuralAnalysis;
using ICL.Core.StructuralModelling;
using ICL.Core.Utilities;

using Karamba;
using Karamba.CrossSections;
using Karamba.Elements;
using Karamba.Geometry;
using Karamba.Loads;
using Karamba.Materials;
using Karamba.Models;
using Karamba.Supports;
using Karamba.Utilities;
using KarambaCommon;
using Karamba.Results;
# ---------- c_script_4: C# ----------
    CartesianEnvironment environment = iEnv as CartesianEnvironment;
    List<CartesianAgent> agents = iAgents.Cast<CartesianAgent>().ToList();
    List<BuilderElement> modelElements = iElem.Cast<BuilderElement>().ToList();
    List<Support> supports = iSupports.Cast<Support>().ToList();
    List<Load> loads = iLoads.Cast<Load>().ToList();


    ICLSlabAgentSystem agentSystem = new ICLSlabAgentSystem(agents, environment)
      {
        ModelElements = modelElements,
        ConstantSupports = supports,
        Loads = loads
        };

    if (iDiagram == 0 || iDiagram > 2)
    {
      agentSystem.ComputeDelaunayConnectivity = false;
      agentSystem.ComputeVoronoiCells = false;
    }
    else if (iDiagram == 1)
    {
      agentSystem.ComputeDelaunayConnectivity = true;
      agentSystem.ComputeVoronoiCells = false;
    }
    else if (iDiagram == 2)
    {
      agentSystem.ComputeDelaunayConnectivity = false;
      agentSystem.ComputeVoronoiCells = true;
    }

    oAgentSystem = agentSystem;
# ---------- end c_script_4 ----------
icl_slab_sys = DefineICLSlabAgentSystem(
    CartesianEnvironment=c_script_3.oEnvironment,
    CartesianAgents=cartesian_agent,
    ComputeDiagram=number_slider,
    Elements=meshtoshell.Element,
    ConstantSupports=support_2,
    Load=load)  # disabled
solver = StepByStepSolver(Reset=Button(), Execute=Toggle(False), AgentSystems=c_script_4.oAgentSystem)  # -> DisplayGeometries, AllAgentSystems, IterationCount

# ---- group: Nodal Disp
nodedisp = NodalDisplacementsKaramba3D(AnalyzedModel=analyze.CalculatedModel)  # -> AnalyzedModel, NodalTranslations_m, NodalRotations_rad

# ----
c_script_5 = CSharpScript(
    x=solver.AllAgentSystems,
    Reference=["C:\Users\lui-o\AppData\Roaming\Grasshopper\Libraries\ICL.Core.dll", "C:\Program Files\Rhino 7\Plug-ins\Karamba\karamba.dll", "C:\Program Files\Rhino 7\Plug-ins\Karamba\karambaCommon.dll", "C:\Users\lui-o\AppData\Roaming\McNeel\Rhinoceros\packages\7.0\ABxM-Core\1.5.4\ABxM.Core.dll", "C:\Program Files\Rhino 7\Plug-ins\Karamba\karamba.gha"])  # -> out, A
# ---------- c_script_5: C# usings ----------
using System.Data;
using System.Drawing;
using System.IO;
using System.Linq;
using System.Reflection;
using System.Runtime.InteropServices;
using System.Xml;
using System.Xml.Linq;

using Rhino.Collections;
using Rhino.DocObjects;
using Grasshopper.Kernel.Geometry;
using Grasshopper.Kernel.Geometry.Delaunay;
using Grasshopper.Kernel.Geometry.Voronoi;
using GH_IO;
using GH_IO.Serialization;

using ABxM.Core;
using ABxM.Core.Agent;
using ABxM.Core.AgentSystem;
using ABxM.Core.Behavior;
using ABxM.Core.Environments;
using ABxM.Core.Utilities;

using ICL.Core;
using ICL.Core.AgentBehaviors;
using ICL.Core.AgentSystem;
using ICL.Core.Environment;
using ICL.Core.ICLsolver;
using ICL.Core.StructuralAnalysis;
using ICL.Core.StructuralModelling;
using ICL.Core.Utilities;

using Karamba;
using Karamba.CrossSections;
using Karamba.Elements;
using Karamba.Geometry;
using Karamba.Loads;
using Karamba.Materials;
using Karamba.Models;
using Karamba.Supports;
using Karamba.Utilities;
using KarambaCommon;
using Karamba.Results;
using Karamba.GHopper;
using Karamba.GHopper.Geometry;
# ---------- c_script_5: C# ----------
    ICLSlabAgentSystem agentSystem = x as ICLSlabAgentSystem;
    Model karambaModel = agentSystem.KarambaModel;

    A = new Karamba.GHopper.Models.GH_Model(karambaModel);
# ---------- end c_script_5 ----------
model = ModelKaramba3D(c_script_5.A)

# ---- group: View Results
panel_5 = Panel("12, 9, 2 gradients are good")
clr = ColorsAlpaca4d(gradIndex=Slider(9, range=0..12))  # -> colors; inputs gradIndex: Int32
#   port colors: A series of colors to be plugged into the "Ladybug_Legend Parameters" component.
# ---------- clr: Python ----------
"""
Preset of gradient colors perfect for Data Visualisation
    Inputs:
        gradIndex: An index refering to one of the following possible gradients:
            0 - Orignal Ladybug
            1 - Nuanced Ladybug
            2 - Multi-colored Ladybug
            3 - Ecotect
            4 - Thermal Comfort Percentage
            5 - Thermal Comfort Colors
            6 - Shade Benefit/Harm
            7 - Shade Harm
            8 - Shade Benefit
            9 - CFD Colors 1
            10 - Radiation Benefit
            11 - Gsa10 Colour
            12 - Gsa9 Colour
    Returns:
        customColors: A series of colors.
"""

ghenv.Component.Name = "Colors (Alpaca4d)"
ghenv.Component.NickName = 'CLR'
ghenv.Component.Message = 'Colors (Alpaca4d)'

import scriptcontext as sc
import Grasshopper.Kernel as gh
import System

gradientLibrary = {
        0: [System.Drawing.Color.FromArgb(75, 107, 169), System.Drawing.Color.FromArgb(115, 147, 202), System.Drawing.Color.FromArgb(170, 200, 247), System.Drawing.Color.FromArgb(193, 213, 208), System.Drawing.Color.FromArgb(245, 239, 103), System.Drawing.Color.FromArgb(252, 230, 74), System.Drawing.Color.FromArgb(239, 156, 21), System.Drawing.Color.FromArgb(234, 123, 0), System.Drawing.Color.FromArgb(234, 74, 0), System.Drawing.Color.FromArgb(234, 38, 0)],
        1: [System.Drawing.Color.FromArgb(49,54,149), System.Drawing.Color.FromArgb(69,117,180), System.Drawing.Color.FromArgb(116,173,209), System.Drawing.Color.FromArgb(171,217,233), System.Drawing.Color.FromArgb(224,243,248), System.Drawing.Color.FromArgb(255,255,191), System.Drawing.Color.FromArgb(254,224,144), System.Drawing.Color.FromArgb(253,174,97), System.Drawing.Color.FromArgb(244,109,67), System.Drawing.Color.FromArgb(215,48,39), System.Drawing.Color.FromArgb(165,0,38)],
        2: [System.Drawing.Color.FromArgb(4,25,145), System.Drawing.Color.FromArgb(7,48,224), System.Drawing.Color.FromArgb(7,88,255), System.Drawing.Color.FromArgb(1,232,255), System.Drawing.Color.FromArgb(97,246,156), System.Drawing.Color.FromArgb(166,249,86), System.Drawing.Color.FromArgb(254,244,1), System.Drawing.Color.FromArgb(255,121,0), System.Drawing.Color.FromArgb(239,39,0), System.Drawing.Color.FromArgb(138,17,0)],
        3: [System.Drawing.Color.FromArgb(0,0,255), System.Drawing.Color.FromArgb(53,0,202), System.Drawing.Color.FromArgb(107,0,148), System.Drawing.Color.FromArgb(160,0,95), System.Drawing.Color.FromArgb(214,0,41), System.Drawing.Color.FromArgb(255,12,0), System.Drawing.Color.FromArgb(255,66,0), System.Drawing.Color.FromArgb(255,119,0), System.Drawing.Color.FromArgb(255,173,0), System.Drawing.Color.FromArgb(255,226,0), System.Drawing.Color.FromArgb(255,255,0)],
        4: [System.Drawing.Color.FromArgb(0,0,0), System.Drawing.Color.FromArgb(110,0,153), System.Drawing.Color.FromArgb(255,0,0), System.Drawing.Color.FromArgb(255,255,102), System.Drawing.Color.FromArgb(255,255,255)],
        5: [System.Drawing.Color.FromArgb(0,136,255), System.Drawing.Color.FromArgb(200,225,255), System.Drawing.Color.FromArgb(255,255,255), System.Drawing.Color.FromArgb(255,230,230), System.Drawing.Color.FromArgb(255,0,0)],
        6: [System.Drawing.Color.FromArgb(5,48,97), System.Drawing.Color.FromArgb(33,102,172), System.Drawing.Color.FromArgb(67,147,195), System.Drawing.Color.FromArgb(146,197,222), System.Drawing.Color.FromArgb(209,229,240), System.Drawing.Color.FromArgb(255,255,255), System.Drawing.Color.FromArgb(253,219,199), System.Drawing.Color.FromArgb(244,165,130), System.Drawing.Color.FromArgb(214,96,77), System.Drawing.Color.FromArgb(178,24,43), System.Drawing.Color.FromArgb(103,0,31)],
        7: [System.Drawing.Color.FromArgb(255,255,255), System.Drawing.Color.FromArgb(253,219,199), System.Drawing.Color.FromArgb(244,165,130), System.Drawing.Color.FromArgb(214,96,77), System.Drawing.Color.FromArgb(178,24,43), System.Drawing.Color.FromArgb(103,0,31)],
        8: [System.Drawing.Color.FromArgb(255,255,255), System.Drawing.Color.FromArgb(209,229,240), System.Drawing.Color.FromArgb(146,197,222), System.Drawing.Color.FromArgb(67,147,195), System.Drawing.Color.FromArgb(33,102,172), System.Drawing.Color.FromArgb(5,48,97)],
        9: [System.Drawing.Color.FromArgb(0,16,120), System.Drawing.Color.FromArgb(38,70,160), System.Drawing.Color.FromArgb(5,180,222), System.Drawing.Color.FromArgb(16,180,109), System.Drawing.Color.FromArgb(59,183,35), System.Drawing.Color.FromArgb(143,209,19), System.Drawing.Color.FromArgb(228,215,29), System.Drawing.Color.FromArgb(246,147,17), System.Drawing.Color.FromArgb(243,74,0), System.Drawing.Color.FromArgb(255,0,0)],
        10: [System.Drawing.Color.FromArgb(0,191,48), System.Drawing.Color.FromArgb(255,238,184), System.Drawing.Color.FromArgb(255,0,0)],
        11: [System.Drawing.Color.FromArgb(204,0,71), System.Drawing.Color.FromArgb(255,182,71), System.Drawing.Color.FromArgb(206,255,115), System.Drawing.Color.FromArgb(26,180, 214),System.Drawing.Color.FromArgb(0,0,207)],
        12: [System.Drawing.Color.FromArgb(255, 51, 51), System.Drawing.Color.FromArgb(255, 170, 51), System.Drawing.Color.FromArgb(255, 255, 51), System.Drawing.Color.FromArgb(170, 255, 125), System.Drawing.Color.FromArgb(51, 255, 231), System.Drawing.Color.FromArgb(51, 170, 255), System.Drawing.Color.FromArgb(51,51, 255)]}
colors = gradientLibrary[gradIndex]
# ---------- end clr ----------
modelview = ModelViewKaramba3D(Model=model, ResultFactors=1, ResultCase=-1, Colors=clr)  # -> Model, DeformedMesh, DeformedAxes, DeformedModel
shellview = ShellViewKaramba3D(Model=modelview.Model, IndexOfLayer=0)  # -> Model, MeshesOfRenderedShells, LegendColors, LegendTags
legend = Legend(Colour=shellview.LegendColors, Tags=shellview.LegendTags, LegendType=1)
panel_6 = Panel(shellview.LegendTags)

# ---- group: Magnifixy Deformation
pdecon = Deconstruct(Point=nodedisp.NodalTranslations_m)  # -> XComponent, YComponent, ZComponent
abs = Absolute(Value=pdecon.ZComponent)
multiplication = Multiplication(A=abs, B=Slider(1000, range=0..1000))
c_script_6 = CSharpScript(trans=multiplication, mesh=modelview.DeformedMesh)  # -> out, A; inputs trans: list of Double, mesh: Mesh; disabled
# ---------- c_script_6: C# ----------
    List<Point3d> pts = new List<Point3d>();
    for(int i = 0; i < mesh.Vertices.Count; i++)
    {
      Point3d pt = new Point3d(mesh.Vertices[i].X, mesh.Vertices[i].Y, trans[i] * -1);
      pts.Add(pt);
    }
    A = pts;
# ---------- end c_script_6 ----------
pt_2 = Point(c_script_6.A)

# ----
panel_7 = Panel(c_script_5.out)
