# Grasshopper definition 240404-DMS-ABM.gh (Grasshopper 1.0.7)
# plug-ins: Karamba3D, ABxM.Grasshopper, ICL.GH

# ---- group: Columns
floorboundary = Curve(reparameterize(<curve referenced from the Rhino model>))
columns = Point(flatten([<point referenced from the Rhino model> x48]))
offsetcurve = Curve(<curve referenced from the Rhino model>)
support_walls = Curve(<curve referenced from the Rhino model>)
smallexclusionzone = Curve(<curve referenced from the Rhino model>)
bigexclusionzone = Curve(<curve referenced from the Rhino model>)

# ----
edgeexclusionzone = Curve(<curve referenced from the Rhino model>)
number_slider = Slider(5, range=0..10)
bbox = BoundingBox(Content=floorboundary, Plane=PlaneXY(0, 0, 0))  # -> Box, Box_2
dim = Dimensions(Surface=bbox.Box)  # -> UDimension, VDimension
con = DelaunayEdges(Points=columns, Plane=PlaneXY(0, 0, 0))  # -> Connectivity, Edges
multiplication = Multiplication(A=dim.UDimension, B=number_slider)
multiplication_2 = Multiplication(A=dim.VDimension, B=number_slider)
sort = SortList(Keys=con.Edges)  # -> Keys, ValuesA
lng = ListLength(List=sort.Keys)
division = Division(A=lng, B=2)
sqgrid = Square(Plane=PlaneXY(0, 0, 0), Size=Slider(0.2, range=0..1), ExtentX=multiplication, ExtentY=multiplication_2)  # -> Cells, flatten(Points)
avr = Average(Input=sort.Keys)
average_mean = Panel(avr)
round = Round(Number=division)  # -> Nearest, Floor, Ceiling
incurve = PointInCurve(Point=flatten(sqgrid.Points), Curve=offsetcurve)  # -> Relationship, Point
item = ListItem(List=sort.Keys, Index=round.Nearest, Wrap=True)
minimum = Panel(sort.Keys)
median = Panel(item)
equals = Equality(FirstNumber=incurve.Relationship, SecondNumber=Slider(2, range=0..10))  # -> Equality, Inequality
explode = Explode(Curve=support_walls, Recursive=True)  # -> Segments, Vertices
item_2 = ListItem(List=sort.Keys, Index=Slider(4, range=0..10), Wrap=True)
dispatch = Dispatch(List=sqgrid.Points, DispatchPattern=equals.Equality)  # -> ListA, ListB
panel = Panel("""10
5
10
5""")
pt = Point(dispatch.ListA)
panel_2 = Panel(item_2)
boundary = BoundarySurfaces(Edges=floorboundary)
divide = DivideCurve(Curve=explode.Segments, Count=panel, Kinks=False)  # -> flatten(Points), Tangents, Parameters
cullpt = CullDuplicates(Points=flatten(divide.Points), Tolerance=Slider(0.01, range=0..0.01), CullMode=1)  # -> Points, Indices, Valence

# ---- group: Material
matselect = MaterialSelectionKaramba3D(menu=[dropdown(1), dropdown(2)])
matprops = MaterialPropertiesKaramba3D(
    FamilyOfMaterial="Solid Timber",
    Name="S235",
    ElementIdentifier="CLT_timber",
    YoungsModulusOfElasticity="1155",
    InPlaneShearModulus_kN_cm2="69",
    TransverseShearModulus_kN_cm2="28.3",
    SpecificWeight_kN_m3="5.50",
    CoefficientOfThermalExpansion_1_C=1.2e-05,
    TensileStrength_kN_cm2="1.4",
    CompressiveStrength_kN_cm2="-2.1",
    StrengthHypothesis="MISES",
    mode="Isotrop")
matselect_2 = MaterialSelectionKaramba3D(menu=[dropdown(7), dropdown(5)])

# ----
fillet = Fillet(Curve=offsetcurve, Radius=Slider(0.5, range=0..1))
disc = Discontinuity(Curve=floorboundary, Level=1)  # -> Points, Parameters

# ---- group: CrossSection
cross_section = CrossSectionKaramba3D(FamilyNameOfCrossSection="slab", Material=matselect_2, Height_cm="30", mode="Shell - Const")

# ----
pt_2 = Point(disc.Points)
core_wall = Point(cullpt.Points)

# ---- group: Agent Behaviour P
number_slider_2 = Slider(1, range=0..1)
number_slider_3 = Slider(0.5, range=0..1)
min_column_span = Slider(3, range=0..10)
max_slab_displ = Slider(0.02, range=0..0.1)

# ----
original_minimum_column_span = Number(item_2)
icl_max_displ = DefineColumnMaximumDisplacementBehavior(Weight=number_slider_2)
remove_column_beh = DefineRemoveColumnAgentBehavior(Weight=number_slider_2, Dist=original_minimum_column_span, Probability=number_slider_3)
crv = Curve(flatten([bigexclusionzone, smallexclusionzone, edgeexclusionzone]))

# ---- group: Column Count
number_slider_4 = Slider(0.4, range=0..1)
column_count = Slider(32, range=0..100)

# ---- group: Mesh
mesh_breps = MeshBreps(
    Brep=boundary,
    InclusionPoints=flatten([cullpt.Points, columns]),
    MeshResolution=number_slider_4,
    EdgeRefinementFactor=Slider(1, range=0..1),
    PointReduction=False,
    SmoothingStepSize=0.8,
    SmoothingIterations=5)  # -> Mesh, Info
mesh = Mesh(mesh_breps.Mesh)

# ---- group: ColumnStartPoints
divide_2 = DivideCurve(Curve=fillet, Count=column_count, Kinks=False)  # -> Points, Tangents, Parameters
demesh = DeconstructMesh(Mesh=mesh)  # -> Vertices, Faces, Colours, Normals
cp = ClosestPoint(Point=divide_2.Points, Cloud=demesh.Vertices)  # -> ClosestPoint, CPIndex, Distance

# ----
c_script = CSharpScript(iMesh=mesh, iColumns=columns)  # -> out, oVertexColumns; inputs iMesh: Mesh, iColumns: list of Point3d
# ---------- c_script: C# ----------
    List<Point3d> vertices = new List<Point3d>();
    PointCloud cloud = new PointCloud();
    List<Point3d> closestPoints = new List<Point3d>();
    foreach (Point3d vertex in iMesh.Vertices)
    {
      vertices.Add(vertex);
      cloud.Add(vertex);
    }
    foreach (Point3d column in iColumns)
    {
      int closestIndex = cloud.ClosestPoint(column);
      Point3d closestPoint = cloud[closestIndex].Location;
      closestPoints.Add(closestPoint);
    }
    oVertexColumns = closestPoints;
# ---------- end c_script ----------

# ---- group: Define elements
meshtoshell = MeshToShellKaramba3D(Mesh=mesh, Identifier="Shell_1", CrossSection=cross_section, LimitDistance_m=0.005)  # -> Element, Points, Info
element = ElementKaramba3D(flatten(meshtoshell.Element))

# ----
field_columns = Point(c_script.oVertexColumns)

# ---- group: Supports
supp = SupportKaramba3D(PosInd=flatten(field_columns), menu=[buttons(on, on, on, off, off, off)])
supp_2 = SupportKaramba3D(PosInd=flatten(core_wall), menu=[buttons(on, on, on, off, off, on)])
support = SupportKaramba3D(flatten([supp, supp_2]))

# ----
c_script_2 = CSharpScript(
    iBoundaryCorners=pt_2,
    iMesh=mesh,
    Reference="C:\Users\lui-o\AppData\Roaming\McNeel\Rhinoceros\packages\7.0\ABxM-Core\1.5.4\ABxM.Core.dll")  # -> out, oEnvironment; inputs iBoundaryCorners: list of Point3d, iMesh: Mesh
# ---------- c_script_2: C# usings ----------
using System.IO;
using System.Linq;
using System.Data;
using System.Drawing;
using System.Reflection;
using System.Windows.Forms;
using System.Xml;
using System.Xml.Linq;
using System.Runtime.InteropServices;

using Rhino.DocObjects;
using Rhino.Collections;
using GH_IO;
using GH_IO.Serialization;
using ABxM.Core;
using ABxM.Core.Utilities;
using ABxM.Core.Environments;
using ABxM.Core.Behavior;
using ABxM.Core.Agent;
using ABxM.Core.AgentSystem;
# ---------- c_script_2: C# ----------
    Dictionary < string, object > displDict = new Dictionary<string, object>();
    for (int i = 0; i < iMesh.Vertices.Count(); i++)
    {
      displDict.Add(i.ToString(), i);
    }
    oEnvironment = new CartesianEnvironment(iBoundaryCorners){CustomData = displDict};
# ---------- end c_script_2 ----------
element_2 = ElementKaramba3D(flatten(element))
support_2 = SupportKaramba3D(flatten(supp_2))
trigger = Trigger(Interval=-1000, TimerInterval=1000, Target=solver)
button = Button()
add_column_beh = DefineAddColumnAgentBehavior(
    Weight=number_slider_2,
    Displ=max_slab_displ,
    Probability=number_slider_3,
    Distance=original_minimum_column_span,
    Reset=button)
cartesian_agent = DefineCartesianAgent(Positions=cp.ClosestPoint, Behaviors=flatten([icl_max_displ, remove_column_beh, add_column_beh]))
minimum_span_parameter_m = Panel(original_minimum_column_span)
swatch = ColourSwatch(SwatchColor=RGB(255, 255, 255))
crv_2 = Curve(<curve referenced from the Rhino model>)

# ---- group: Loads
panel_3 = Panel("3")
Z = UnitZ(Factor="-1")
loads = LoadsKaramba3D(Vector=Z, LCase="0", mode="Gravity")

# ----
Z_2 = UnitZ(Factor=panel_3)
rev = Reverse(Vector=Z_2)

# ---- group: Loads (continued)
loads_2 = LoadsKaramba3D(Vector=rev, Mesh=mesh, LCase="0", mode="MeshLoad -Const.", menu=[buttons(off, off, on), buttons(on, on)])
load = LoadKaramba3D(flatten([loads, loads_2]))

# ---- group: Analyse Model
assemble = AssembleModelKaramba3D(Elem=flatten(element), Support=flatten(support), Load=flatten(load), LimitDistance_m=0.005)  # -> Model, Info, Mass_kg, CenterOfGravity, LoadCaseNames
analyze = AnalyzeKaramba3D(Model=assemble.Model)  # -> CalculatedModel, MaximumDisplacement_cm, ResultingForceOfGravity_kN, ElasticEnergy_kNm
panel_4 = Panel(analyze.MaximumDisplacement_cm)

# ----
load_2 = LoadKaramba3D(flatten(load))
icl_slab_sys = DefineICLSlabAgentSystem(
    CartesianEnvironment=c_script_2.oEnvironment,
    CartesianAgents=cartesian_agent,
    ComputeDiagram="1",
    Elements=element_2,
    ConstantSupports=support_2,
    Load=load_2,
    ExclusionCurves=crv,
    DisplacementThreshold=Slider(0, range=0..100))
solver = StepByStepSolver(Reset=button, Execute=Toggle(False), AgentSystems=icl_slab_sys)  # -> DisplayGeometries, AllAgentSystems, IterationCount
panel_5 = Panel(solver.IterationCount)
solver_silent = SilentSolver(Execute=Toggle(False), AgentSystems=icl_slab_sys, MaxIterationCount=Slider(25, range=0..100))  # -> DisplayGeometries, AllAgentSystems, IterationCount; disabled

# ---- group: Original Shigeru Ban Columns
# Max Disp.
# 0.014137
# 
# Actual Min Span
# 4.021115
# 
# Min Span Param
# 3.169885
# 
# Start Column Count
# 22
model = ModelKaramba3D(analyze.CalculatedModel)

# ----
icl_viz = VisualizeICLSlabAgentSystem(ICLSlabAgentSystem=solver.AllAgentSystems)  # -> KarambaModel, AgentPositions, ExclusionCurves, ExcludedVertices, DelaunayMesh, MaximumDisplacement
pt_3 = Point(icl_viz.AgentPositions)

# ---- group: KarambaModel to GH Karamba Model
c_script_3 = CSharpScript(
    x=icl_viz.KarambaModel,
    Reference=["C:\Program Files\Rhino 7\Plug-ins\Karamba\karamba.dll", "C:\Program Files\Rhino 7\Plug-ins\Karamba\karamba.gha", "C:\Program Files\Rhino 7\Plug-ins\Karamba\karambaCommon.dll"])  # -> out, A
# ---------- c_script_3: C# usings ----------
using Karamba.Models;
using Karamba.GHopper.Geometry;
# ---------- c_script_3: C# ----------
    if (x == null) return;
    Model karambaModel = x as Model;
    var ghKarambaModel = new Karamba.GHopper.Models.GH_Model(karambaModel);
    A = ghKarambaModel;
# ---------- end c_script_3 ----------

# ----
model_2 = ModelKaramba3D(c_script_3.A)
model_3 = ModelKaramba3D(c_script_3.A)

# ---- group: View Results
panel_6 = Panel("12, 9, 2 gradients are good")
clr = ColorsAlpaca4d(gradIndex=Slider(9, range=0..12))  # -> colors; inputs gradIndex: Int32
#   port colors: A series of colors to be plugged into the "Ladybug_Legend Parameters" component.
# ---------- clr: Python ----------
"""
Preset of gradient colors perfect for Data Visualisation
    Inputs:
        gradIndex: An index refering to one of the following possible gradients:
            0 - Orignal Ladybug
            1 - Nuanced Ladybug
            2 - Multi-colored Ladybug
            3 - Ecotect
            4 - Thermal Comfort Percentage
            5 - Thermal Comfort Colors
            6 - Shade Benefit/Harm
            7 - Shade Harm
            8 - Shade Benefit
            9 - CFD Colors 1
            10 - Radiation Benefit
            11 - Gsa10 Colour
            12 - Gsa9 Colour
    Returns:
        customColors: A series of colors.
"""

ghenv.Component.Name = "Colors (Alpaca4d)"
ghenv.Component.NickName = 'CLR'
ghenv.Component.Message = 'Colors (Alpaca4d)'

import scriptcontext as sc
import Grasshopper.Kernel as gh
import System

gradientLibrary = {
        0: [System.Drawing.Color.FromArgb(75, 107, 169), System.Drawing.Color.FromArgb(115, 147, 202), System.Drawing.Color.FromArgb(170, 200, 247), System.Drawing.Color.FromArgb(193, 213, 208), System.Drawing.Color.FromArgb(245, 239, 103), System.Drawing.Color.FromArgb(252, 230, 74), System.Drawing.Color.FromArgb(239, 156, 21), System.Drawing.Color.FromArgb(234, 123, 0), System.Drawing.Color.FromArgb(234, 74, 0), System.Drawing.Color.FromArgb(234, 38, 0)],
        1: [System.Drawing.Color.FromArgb(49,54,149), System.Drawing.Color.FromArgb(69,117,180), System.Drawing.Color.FromArgb(116,173,209), System.Drawing.Color.FromArgb(171,217,233), System.Drawing.Color.FromArgb(224,243,248), System.Drawing.Color.FromArgb(255,255,191), System.Drawing.Color.FromArgb(254,224,144), System.Drawing.Color.FromArgb(253,174,97), System.Drawing.Color.FromArgb(244,109,67), System.Drawing.Color.FromArgb(215,48,39), System.Drawing.Color.FromArgb(165,0,38)],
        2: [System.Drawing.Color.FromArgb(4,25,145), System.Drawing.Color.FromArgb(7,48,224), System.Drawing.Color.FromArgb(7,88,255), System.Drawing.Color.FromArgb(1,232,255), System.Drawing.Color.FromArgb(97,246,156), System.Drawing.Color.FromArgb(166,249,86), System.Drawing.Color.FromArgb(254,244,1), System.Drawing.Color.FromArgb(255,121,0), System.Drawing.Color.FromArgb(239,39,0), System.Drawing.Color.FromArgb(138,17,0)],
        3: [System.Drawing.Color.FromArgb(0,0,255), System.Drawing.Color.FromArgb(53,0,202), System.Drawing.Color.FromArgb(107,0,148), System.Drawing.Color.FromArgb(160,0,95), System.Drawing.Color.FromArgb(214,0,41), System.Drawing.Color.FromArgb(255,12,0), System.Drawing.Color.FromArgb(255,66,0), System.Drawing.Color.FromArgb(255,119,0), System.Drawing.Color.FromArgb(255,173,0), System.Drawing.Color.FromArgb(255,226,0), System.Drawing.Color.FromArgb(255,255,0)],
        4: [System.Drawing.Color.FromArgb(0,0,0), System.Drawing.Color.FromArgb(110,0,153), System.Drawing.Color.FromArgb(255,0,0), System.Drawing.Color.FromArgb(255,255,102), System.Drawing.Color.FromArgb(255,255,255)],
        5: [System.Drawing.Color.FromArgb(0,136,255), System.Drawing.Color.FromArgb(200,225,255), System.Drawing.Color.FromArgb(255,255,255), System.Drawing.Color.FromArgb(255,230,230), System.Drawing.Color.FromArgb(255,0,0)],
        6: [System.Drawing.Color.FromArgb(5,48,97), System.Drawing.Color.FromArgb(33,102,172), System.Drawing.Color.FromArgb(67,147,195), System.Drawing.Color.FromArgb(146,197,222), System.Drawing.Color.FromArgb(209,229,240), System.Drawing.Color.FromArgb(255,255,255), System.Drawing.Color.FromArgb(253,219,199), System.Drawing.Color.FromArgb(244,165,130), System.Drawing.Color.FromArgb(214,96,77), System.Drawing.Color.FromArgb(178,24,43), System.Drawing.Color.FromArgb(103,0,31)],
        7: [System.Drawing.Color.FromArgb(255,255,255), System.Drawing.Color.FromArgb(253,219,199), System.Drawing.Color.FromArgb(244,165,130), System.Drawing.Color.FromArgb(214,96,77), System.Drawing.Color.FromArgb(178,24,43), System.Drawing.Color.FromArgb(103,0,31)],
        8: [System.Drawing.Color.FromArgb(255,255,255), System.Drawing.Color.FromArgb(209,229,240), System.Drawing.Color.FromArgb(146,197,222), System.Drawing.Color.FromArgb(67,147,195), System.Drawing.Color.FromArgb(33,102,172), System.Drawing.Color.FromArgb(5,48,97)],
        9: [System.Drawing.Color.FromArgb(0,16,120), System.Drawing.Color.FromArgb(38,70,160), System.Drawing.Color.FromArgb(5,180,222), System.Drawing.Color.FromArgb(16,180,109), System.Drawing.Color.FromArgb(59,183,35), System.Drawing.Color.FromArgb(143,209,19), System.Drawing.Color.FromArgb(228,215,29), System.Drawing.Color.FromArgb(246,147,17), System.Drawing.Color.FromArgb(243,74,0), System.Drawing.Color.FromArgb(255,0,0)],
        10: [System.Drawing.Color.FromArgb(0,191,48), System.Drawing.Color.FromArgb(255,238,184), System.Drawing.Color.FromArgb(255,0,0)],
        11: [System.Drawing.Color.FromArgb(204,0,71), System.Drawing.Color.FromArgb(255,182,71), System.Drawing.Color.FromArgb(206,255,115), System.Drawing.Color.FromArgb(26,180, 214),System.Drawing.Color.FromArgb(0,0,207)],
        12: [System.Drawing.Color.FromArgb(255, 51, 51), System.Drawing.Color.FromArgb(255, 170, 51), System.Drawing.Color.FromArgb(255, 255, 51), System.Drawing.Color.FromArgb(170, 255, 125), System.Drawing.Color.FromArgb(51, 255, 231), System.Drawing.Color.FromArgb(51, 170, 255), System.Drawing.Color.FromArgb(51,51, 255)]}
colors = gradientLibrary[gradIndex]
# ---------- end clr ----------
modelview = ModelViewKaramba3D(Model=model_3, ResultFactors=1, ResultCase=-1, Colors=clr)  # -> Model, DeformedMesh, DeformedAxes, DeformedModel
shellview = ShellViewKaramba3D(Model=modelview.Model, IndexOfLayer=0)  # -> Model, MeshesOfRenderedShells, LegendColors, LegendTags
legend = Legend(Colour=shellview.LegendColors, Tags=shellview.LegendTags, Rectangle=crv_2, LegendType=1)
panel_7 = Panel(shellview.LegendTags)

# ---- group: Nodal Disp
nodedisp = NodalDisplacementsKaramba3D(AnalyzedModel=model_3)  # -> AnalyzedModel, NodalTranslations_m, NodalRotations_rad

# ---- group: ColumnNames
pt_4 = Point(icl_viz.AgentPositions)
lng_2 = ListLength(List=pt_4)
series = Series(Start=0, Step=1, Count=lng_2)
xy = XYPlane(Origin=pt_4)
tag = TextTag3D(Location=xy, Text=series, Size=1, Justification=7)

# ----
preview = CustomPreview(Geometry=pt_4, Material=swatch)
del = DelaunayMesh(Points=pt_4, Plane=PlaneXY(0, 0, 0))

# ---- group: Verify No Go Zones
pt_5 = Point(icl_viz.ExcludedVertices)
crv_3 = Curve(icl_viz.ExclusionCurves)

# ---- group: Magnifixy Deformation
pdecon = Deconstruct(Point=nodedisp.NodalTranslations_m)  # -> XComponent, YComponent, ZComponent
abs = Absolute(Value=pdecon.ZComponent)
multiplication_3 = Multiplication(A=abs, B=Slider(100, range=0..1000))
num = Number(max_slab_displ)
c_script_4 = CSharpScript(trans=multiplication_3, mesh=modelview.DeformedMesh)  # -> out, A; inputs trans: list of Double, mesh: Mesh; disabled
# ---------- c_script_4: C# ----------
    List<Point3d> pts = new List<Point3d>();
    for(int i = 0; i < mesh.Vertices.Count; i++)
    {
      Point3d pt = new Point3d(mesh.Vertices[i].X, mesh.Vertices[i].Y, trans[i] * -1);
      pts.Add(pt);
    }
    A = pts;
# ---------- end c_script_4 ----------
larger = LargerThan(FirstNumber=abs, SecondNumber=num)  # -> LargerThan, OrEqualTo
bnd = Bounds(Numbers=abs)  # disabled
pt_6 = Point(c_script_4.A)  # disabled
panel_8 = Panel(bnd)  # disabled
dispatch_2 = Dispatch(List=pt_6, DispatchPattern=larger.OrEqualTo)  # -> ListA, ListB; disabled
pt_7 = Point(dispatch_2.ListA)  # disabled

# ---- group: Delaunay Edges
mesh_2 = Mesh(del)
medges = MeshEdges(Mesh=mesh_2)  # -> NakedEdges, InteriorEdges, NonManifoldEdges

# ----
merge = Merge(Data1=medges.NakedEdges, Data2=medges.InteriorEdges, Data3=medges.NonManifoldEdges)  # -> flatten(Result)
sort_2 = SortList(Keys=merge, ValuesA=merge)  # -> Keys, ValuesA
item_3 = ListItem(List=sort_2.ValuesA, Index=0, Wrap=True)
preview_2 = CustomPreview(Geometry=item_3, Material=swatch)
sort_3 = SortList(Keys=multiplication_3)  # -> Keys, ValuesA
item_4 = ListItem(List=reverse(sort_3.Keys), Index=0, Wrap=True)
item_5 = ListItem(List=sort_2.Keys, Index=0, Wrap=True)

# ---- group: Agent System Statistics
lng_3 = ListLength(List=cp.ClosestPoint)
lng_4 = ListLength(List=icl_viz.AgentPositions)
actual_minimum_span_m = Panel(item_5)
current_agents = Panel(lng_4)
starting_agents = Panel(lng_3)
multiplication_4 = Multiplication(A=icl_viz.MaximumDisplacement, B="10000000")
maximum_displacement_m = Panel(multiplication_4)

# ----
panel_9 = Panel(item_4)
